# Dynamo graph Automatic Piping.dyn (Dynamo 2.19.3.6394)
# packages: bimorphNodes 4.2.1, Universo_BIM 19.10.11, MEPover 2022.10.30

# group: Creating Pipes
select_model_element = DSModelElementSelection()  # 1 picked in the model; graph input
curvesFromCADLayers = CAD.CurvesFromCADLayers(importInstance=select_model_element)
layer_to_filter = StringInput("McD-FPS -")  # graph input
boolean = BoolSelector(true)
contains = String.Contains(string=curvesFromCADLayers.layerKeys, searchFor=layer_to_filter, ignoreCase=boolean)
filterByBoolMask = List.FilterByBoolMask(list=curvesFromCADLayers.layerKeys, mask=contains)
number = DoubleInput(0)
count = List.Count(list=filterByBoolMask.in)
number_2 = DoubleInput(1)
sub = count - number_2
number_3 = DoubleInput(1)
range = Range(start=number, end=sub, step=number_3)
getItemAtIndex = List.GetItemAtIndex(list=filterByBoolMask.in, index=range)  # graph output
curvesFromCADLayers_2 = CAD.CurvesFromCADLayers(importInstance=select_model_element, layerNames=getItemAtIndex)
string = StringInput("McD-FPS-150")
boolean_2 = BoolSelector(true)
contains_2 = String.Contains(string=curvesFromCADLayers.layerKeys, searchFor=string, ignoreCase=boolean_2)
filterByBoolMask_2 = List.FilterByBoolMask(list=curvesFromCADLayers.layerKeys, mask=contains_2)
curvesFromCADLayers_3 = CAD.CurvesFromCADLayers(importInstance=select_model_element, layerNames=filterByBoolMask_2.in)

# group: Creating Pipes > Creating pipes as per layers 65Ø
number_4 = DoubleInput(0)
getItemAtIndex_2 = List.GetItemAtIndex(list=curvesFromCADLayers_2.Curve, index=number_4)
string_2 = StringInput("sprinkler pipe")
byName = Elements.PipeType.ByName(name=string_2)
string_3 = StringInput("sprinkler")
byName_2 = Elements.PipingSystemType.ByName(name=string_3)
levels = Levels("FF")
number_5 = DoubleInput(65)
byLines = Custom[Pipe.ByLines](Lines=getItemAtIndex_2, Default=byName, SystemType=byName_2, level=levels, Diameter=number_5, lacing=CrossProduct)  # package MEPover; Creates a pipe by Line, PipeType, SystemType, Level and Diameter

# group: Creating Pipes > Creating pipes as per layers 40Ø
number_6 = DoubleInput(1)
getItemAtIndex_3 = List.GetItemAtIndex(list=curvesFromCADLayers_2.Curve, index=number_6)
string_4 = StringInput("sprinkler pipe")
byName_3 = Elements.PipeType.ByName(name=string_4)
string_5 = StringInput("sprinkler")
byName_4 = Elements.PipingSystemType.ByName(name=string_5)
levels_2 = Levels("FF")
number_7 = DoubleInput(40)
byLines_2 = Custom[Pipe.ByLines](Lines=getItemAtIndex_3, Default=byName_3, SystemType=byName_4, level=levels_2, Diameter=number_7, lacing=CrossProduct)

# group: Creating Pipes > Creating pipes as per layers 80Ø
number_8 = DoubleInput(3)
getItemAtIndex_4 = List.GetItemAtIndex(list=curvesFromCADLayers_2.Curve, index=number_8)
string_6 = StringInput("sprinkler pipe")
byName_5 = Elements.PipeType.ByName(name=string_6)
string_7 = StringInput("sprinkler")
byName_6 = Elements.PipingSystemType.ByName(name=string_7)
levels_3 = Levels("FF")
number_9 = DoubleInput(80)
byLines_3 = Custom[Pipe.ByLines](Lines=getItemAtIndex_4, Default=byName_5, SystemType=byName_6, level=levels_3, Diameter=number_9, lacing=CrossProduct)

# group: Creating Pipes > Creating pipes as per layers 32Ø
number_10 = DoubleInput(2)
getItemAtIndex_5 = List.GetItemAtIndex(list=curvesFromCADLayers_2.Curve, index=number_10)
string_8 = StringInput("sprinkler pipe")
byName_7 = Elements.PipeType.ByName(name=string_8)
string_9 = StringInput("sprinkler")
byName_8 = Elements.PipingSystemType.ByName(name=string_9)
levels_4 = Levels("FF")
number_11 = DoubleInput(32)
byLines_4 = Custom[Pipe.ByLines](Lines=getItemAtIndex_5, Default=byName_7, SystemType=byName_8, level=levels_4, Diameter=number_11)

# group: Creating Pipes > Creating pipes as per layers 50Ø
number_12 = DoubleInput(6)
getItemAtIndex_6 = List.GetItemAtIndex(list=curvesFromCADLayers_2.Curve, index=number_12)
string_10 = StringInput("sprinkler pipe")
byName_9 = Elements.PipeType.ByName(name=string_10)
string_11 = StringInput("sprinkler")
byName_10 = Elements.PipingSystemType.ByName(name=string_11)
levels_5 = Levels("FF")
number_13 = DoubleInput(50)
byLines_5 = Custom[Pipe.ByLines](Lines=getItemAtIndex_6, Default=byName_9, SystemType=byName_10, level=levels_5, Diameter=number_13, lacing=CrossProduct)

# group: Creating Pipes > Creating pipes as per layers 100Ø
number_14 = DoubleInput(5)
getItemAtIndex_7 = List.GetItemAtIndex(list=curvesFromCADLayers_2.Curve, index=number_14)
string_12 = StringInput("sprinkler pipe")
byName_11 = Elements.PipeType.ByName(name=string_12)
string_13 = StringInput("sprinkler")
byName_12 = Elements.PipingSystemType.ByName(name=string_13)
levels_6 = Levels("FF")
number_15 = DoubleInput(100)
byLines_6 = Custom[Pipe.ByLines](Lines=getItemAtIndex_7, Default=byName_11, SystemType=byName_12, level=levels_6, Diameter=number_15, lacing=CrossProduct)

# group: Creating Pipes > Creating pipes as per layers 25Ø
number_16 = DoubleInput(4)
getItemAtIndex_8 = List.GetItemAtIndex(list=curvesFromCADLayers_2.Curve, index=number_16)
string_14 = StringInput("sprinkler pipe")
byName_13 = Elements.PipeType.ByName(name=string_14)
string_15 = StringInput("sprinkler")
byName_14 = Elements.PipingSystemType.ByName(name=string_15)
levels_7 = Levels("FF")
number_17 = DoubleInput(25)
byLines_7 = Custom[Pipe.ByLines](Lines=getItemAtIndex_8, Default=byName_13, SystemType=byName_14, level=levels_7, Diameter=number_17)

# group: Creating Pipes > Creating pipes as per layers 150Ø
number_18 = DoubleInput(0)
getItemAtIndex_9 = List.GetItemAtIndex(list=curvesFromCADLayers_3.Curve, index=number_18)
string_16 = StringInput("sprinkler pipe")
byName_15 = Elements.PipeType.ByName(name=string_16)
string_17 = StringInput("sprinkler")
byName_16 = Elements.PipingSystemType.ByName(name=string_17)
levels_8 = Levels("FF")
number_19 = DoubleInput(150)
byLines_8 = Custom[Pipe.ByLines](Lines=getItemAtIndex_9, Default=byName_15, SystemType=byName_16, level=levels_8, Diameter=number_19, lacing=CrossProduct)
