# Dynamo graph CAD Block Fixture Placement.dyn (Dynamo 2.19.3.6394)
# packages: Genius Loci 2023.7.13

enyter_your_family_type_name = StringInput("Pendent_Sprinkler")  # graph input
byName = FamilyType.ByName(name=enyter_your_family_type_name)
select_your_required_cad_block = DSModelElementSelection()  # "Select your required CAD Block Layout"; nothing selected; graph input
cad_block = Custom[CAD Block](importInstance=select_your_required_cad_block)  # package Genius Loci; Get the location point, name and layer of the CAD blocks / XRefs from a CAD link or import. Please note : The non-uniform scaling of blocks is not supported (The X, Y and Z values ​​of the Block Scale must be the same).
X = Point.X(point=cad_block.OriginPoint)
Y = Point.Y(point=cad_block.OriginPoint)
Z = Point.Z(point=cad_block.OriginPoint)
byCoordinates = Point.ByCoordinates(x=X, y=Y, z=Z)
byPoint = FamilyInstance.ByPoint(familyType=byName, point=byCoordinates)  # graph output
