# Dynamo graph Create Views and Sheets.dyn (Dynamo 2.3.1.11775)

# group: INPUT
element_types = ElementTypes("Level")
all_elements_of_type = ElementsOfType(element_type=element_types)

# group: Create Floor Plan Sheet Name
name = Level.Name(level=all_elements_of_type)
code_block = CodeBlock { " CEILING PLAN"; }
add = name + code_block

# group: Create Floor Plan Sheet Name
name_2 = Level.Name(level=all_elements_of_type)
code_block_2 = CodeBlock { " FLOOR PLAN"; }
add_2 = name_2 + code_block_2

list_create = List.Create(item0=add, item1=add_2)

# group: Create Floor Plan Number
code_block_3 = CodeBlock { "A-"; }
code_block_4 = CodeBlock { 101; }
count = List.Count(list=all_elements_of_type)
code_block_5 = CodeBlock { 1; }
sequence = Sequence(start=code_block_4, amount=count, step=code_block_5)
add_3 = code_block_3 + sequence

# group: Create Ceiling Plan Number
code_block_6 = CodeBlock { "AC-"; }
code_block_7 = CodeBlock { 101; }
count_2 = List.Count(list=all_elements_of_type)
code_block_8 = CodeBlock { 1; }
sequence_2 = Sequence(start=code_block_7, amount=count_2, step=code_block_8)
add_4 = code_block_6 + sequence_2

list_create_2 = List.Create(item0=add_3, item1=add_4)
family_types = FamilyTypes("A0 metric:A0 metric")

# group: Create Floor Plan
byLevel = FloorPlanView.ByLevel(level=all_elements_of_type)
code_block_9 = CodeBlock { "View Name"; }
name_3 = Level.Name(level=all_elements_of_type)
code_block_10 = CodeBlock { " Floor Plan"; }
add_5 = name_3 + code_block_10
setParameterByName = Element.SetParameterByName(element=byLevel, parameterName=code_block_9, value=add_5)

# group: Create Ceiling Plan
byLevel_2 = CeilingPlanView.ByLevel(level=all_elements_of_type)
code_block_11 = CodeBlock { "View Name"; }
name_4 = Level.Name(level=all_elements_of_type)
code_block_12 = CodeBlock { " Ceiling Plan"; }
add_6 = name_4 + code_block_12
setParameterByName_2 = Element.SetParameterByName(element=byLevel_2, parameterName=code_block_11, value=add_6)

list_create_3 = List.Create(item0=setParameterByName, item1=setParameterByName_2)

# group: OUT PUT
byNameNumberTitleBlockAndView = Sheet.ByNameNumberTitleBlockAndView(sheetName=list_create, sheetNumber=list_create_2, titleBlockFamilyType=family_types, view=list_create_3)
