# Dynamo graph Dimension Scripts X Axis.dyn (Dynamo 2.19.3.6394)

current = Document.Current()
activeView = Document.ActiveView(document=current)
select_model_elements = DSModelElementsSelection()  # 7 picked in the model; graph input
getLocation = Element.GetLocation(element=select_model_elements)
number = DoubleInput(0)
count = List.Count(list=getLocation)
number_2 = DoubleInput(1)
sub = count - number_2
range = Range(start=number, end=sub, step=number_2)
getItemAtIndex = List.GetItemAtIndex(list=getLocation, index=range)
list_create = List.Create(item0=getItemAtIndex)
X = Point.X(point=getItemAtIndex)
list_create_2 = List.Create(item0=X)
Y = Point.Y(point=getItemAtIndex)
list_create_3 = List.Create(item0=Y)
number_3 = DoubleInput(100)
add = list_create_3 + number_3
byCoordinates = Point.ByCoordinates(x=list_create_2, y=add)
byStartPointEndPoint = Line.ByStartPointEndPoint(startPoint=list_create, endPoint=byCoordinates)
byCurve = ModelCurve.ByCurve(curve=byStartPointEndPoint)
number_4 = DoubleInput(0)
number_5 = DoubleInput(1)
range_2 = Range(start=number_4, end=sub, step=number_5)
getItemAtIndex_2 = List.GetItemAtIndex(list=getLocation, index=range_2)
X_2 = Point.X(point=getItemAtIndex_2)
Y_2 = Point.Y(point=getItemAtIndex_2)
byCoordinates_2 = Point.ByCoordinates(x=X_2, y=Y_2)
number_6 = DoubleInput(1)
number_7 = DoubleInput(1)
range_3 = Range(start=number_6, end=sub, step=number_7)
getItemAtIndex_3 = List.GetItemAtIndex(list=getLocation, index=range_3)
X_3 = Point.X(point=getItemAtIndex_3)
Y_3 = Point.Y(point=getItemAtIndex_3)
byCoordinates_3 = Point.ByCoordinates(x=X_3, y=Y_3)
byStartPointEndPoint_2 = Line.ByStartPointEndPoint(startPoint=byCoordinates_2, endPoint=byCoordinates_3)
byElements = Dimension.ByElements(view=activeView, referenceElements=byCurve, line=byStartPointEndPoint_2)
