# Dynamo graph Dimension Scripts Y Axis.dyn (Dynamo 2.19.3.6394)

current = Document.Current()
activeView = Document.ActiveView(document=current)
select_model_elements = DSModelElementsSelection()  # 11 picked in the model; graph input
getLocation = Element.GetLocation(element=select_model_elements)
X = Point.X(point=getLocation)
number = DoubleInput(100)
add = X + number
Y = Point.Y(point=getLocation)
byCoordinates = Point.ByCoordinates(x=add, y=Y)
byStartPointEndPoint = Line.ByStartPointEndPoint(startPoint=getLocation, endPoint=byCoordinates)
byCurve = ModelCurve.ByCurve(curve=byStartPointEndPoint)
list_create = List.Create(item0=getLocation)
number_2 = DoubleInput(0)
getItemAtIndex = List.GetItemAtIndex(list=list_create, index=number_2)
number_3 = DoubleInput(0)
count = List.Count(list=getItemAtIndex)
number_4 = DoubleInput(1)
sub = count - number_4
number_5 = DoubleInput(1)
range = Range(start=number_3, end=sub, step=number_5)
getItemAtIndex_2 = List.GetItemAtIndex(list=getItemAtIndex, index=range)
X_2 = Point.X(point=getItemAtIndex_2)
Y_2 = Point.Y(point=getItemAtIndex_2)
byCoordinates_2 = Point.ByCoordinates(x=X_2, y=Y_2)
number_6 = DoubleInput(1)
count_2 = List.Count(list=getItemAtIndex)
number_7 = DoubleInput(1)
sub_2 = count_2 - number_7
number_8 = DoubleInput(1)
range_2 = Range(start=number_6, end=sub_2, step=number_8)
getItemAtIndex_3 = List.GetItemAtIndex(list=getItemAtIndex, index=range_2)
X_3 = Point.X(point=getItemAtIndex_3)
Y_3 = Point.Y(point=getItemAtIndex_3)
byCoordinates_3 = Point.ByCoordinates(x=X_3, y=Y_3)
byStartPointEndPoint_2 = Line.ByStartPointEndPoint(startPoint=byCoordinates_2, endPoint=byCoordinates_3)
byElements = Dimension.ByElements(view=activeView, referenceElements=byCurve, line=byStartPointEndPoint_2)
