# Dynamo graph Equal Distance sequencing.dyn (Dynamo 2.19.3.6394)

family_type_name = StringInput("Pendent_Sprinkler")  # graph input
byName = FamilyType.ByName(name=family_type_name)
select_your_room = DSModelElementSelection()  # 1 picked in the model; graph input
finishBoundary = Room.FinishBoundary(room=select_your_room)
byJoinedCurves = PolyCurve.ByJoinedCurves(curves=finishBoundary)
points = PolyCurve.Points(polyCurve=byJoinedCurves)
code_block = CodeBlock { 0; }
getItemAtIndex = List.GetItemAtIndex(list=points, index=code_block)
code_block_2 = CodeBlock { 1; }
getItemAtIndex_2 = List.GetItemAtIndex(list=getItemAtIndex, index=code_block_2)
X = Point.X(point=getItemAtIndex_2)
code_block_3 = CodeBlock { 0; }
code_block_4 = CodeBlock { 3; }
code_block_5 = CodeBlock { 1; }
range = Range(start=code_block_3, end=code_block_4, step=code_block_5)
fixture_coverage_diameter = DoubleInput(0)  # graph input

# group: X axis Fixture placements
getItemAtIndex_3 = List.GetItemAtIndex(list=getItemAtIndex, index=range)
code_block_6 = CodeBlock { 3; }
getItemAtIndex_4 = List.GetItemAtIndex(list=getItemAtIndex_3, index=code_block_6)
X_2 = Point.X(point=getItemAtIndex_4)
code_block_7 = CodeBlock { 0; }
getItemAtIndex_5 = List.GetItemAtIndex(list=getItemAtIndex_3, index=code_block_7)
X_3 = Point.X(point=getItemAtIndex_5)
sub = X_2 - X_3
mod = sub % fixture_coverage_diameter
code_block_8 = CodeBlock { 2; }
div = mod / code_block_8
add = X_3 + div
range_2 = Range(start=X_2, end=add, step=fixture_coverage_diameter)
Y = Point.Y(point=getItemAtIndex_4)
byCoordinates = Point.ByCoordinates(x=range_2, y=Y)

add_2 = X + div
code_block_9 = CodeBlock { 3; }
getItemAtIndex_6 = List.GetItemAtIndex(list=getItemAtIndex, index=code_block_9)
X_4 = Point.X(point=getItemAtIndex_6)
sub_2 = X_4 - div
range_3 = Range(start=add_2, end=sub_2, step=fixture_coverage_diameter)
Y_2 = Point.Y(point=getItemAtIndex_2)

# group: X axis Fixture placements > Y Axis Fixture placements
getItemAtIndex_7 = List.GetItemAtIndex(list=getItemAtIndex, index=range)
code_block_10 = CodeBlock { 0; }
getItemAtIndex_8 = List.GetItemAtIndex(list=getItemAtIndex_7, index=code_block_10)
Y_3 = Point.Y(point=getItemAtIndex_8)
code_block_11 = CodeBlock { 1; }
getItemAtIndex_9 = List.GetItemAtIndex(list=getItemAtIndex_7, index=code_block_11)
Y_4 = Point.Y(point=getItemAtIndex_9)
sub_3 = Y_3 - Y_4
mod_2 = sub_3 % fixture_coverage_diameter
code_block_12 = CodeBlock { 2; }
div_2 = mod_2 / code_block_12
X_5 = Point.X(point=getItemAtIndex_9)
add_3 = Y_4 + div_2
range_4 = Range(start=add_3, end=Y_3, step=fixture_coverage_diameter)
byCoordinates_2 = Point.ByCoordinates(x=X_5, y=range_4)

add_4 = Y_2 + div_2
Y_5 = Point.Y(point=getItemAtIndex_6)
range_5 = Range(start=add_4, end=Y_5, step=fixture_coverage_diameter)
byCoordinates_3 = Point.ByCoordinates(x=range_3, y=range_5, lacing=CrossProduct)
placed_fixtures = FamilyInstance.ByPoint(familyType=byName, point=byCoordinates_3)  # graph output
sub_4 = Y_5 - div_2
